# Dynamo graph Parametric Bridge.dyn (Dynamo 3.0.3.7597)

select_model_element = DSModelElementSelection()  # 1 picked in the model
the_model_line_on_the_floor_of = Element.Curves(element=select_model_element)  # "The Model Line on the Floor of the Bridge"
getLocation = Element.GetLocation(element=select_model_element)
categories = Categories("OST_Walls")
all_elements_of_category = ElementsOfCategory(Category=categories)
code_block = CodeBlock { "Unconnected Height"; }
getParameterValueByName = Element.GetParameterValueByName(element=all_elements_of_category, parameterName=code_block)
code_block_2 = CodeBlock(x=getParameterValueByName) { x[0]; }
the_model_line_needs_to_moves_up = CodeBlock(H=code_block_2) { H/2; }  # "the Model Line Needs to Moves Up by?"
the_model_line_in_the_moddle_of = Geometry.Translate(geometry=getLocation, zTranslation=the_model_line_needs_to_moves_up)  # "The Model Line in the Moddle of the Bridge"
the_number_of_points = DoubleSlider(30, range=2..50 step 1)
code_block_3 = CodeBlock(i=the_number_of_points) { 0..1..#i; }
pointAtParameter = Curve.PointAtParameter(curve=the_model_line_in_the_moddle_of, param=code_block_3)
code_block_4 = CodeBlock { 1; }
byCoordinates = Vector.ByCoordinates(x=code_block_4)
byOriginNormal = Plane.ByOriginNormal(origin=pointAtParameter, normal=byCoordinates)
width = DoubleSlider(2700, range=0..5000 step 100)
length = DoubleSlider(2800, range=0..5000 step 100)
outside_rectangle = Rectangle.ByWidthLength(plane=byOriginNormal, width=width, length=length)
XAxis = Vector.XAxis()
code_block_5 = CodeBlock(p=the_number_of_points) { 0..180..#p; }
code_block_6 = CodeBlock { 1; }
the_modified_angles_for_rotation = CodeBlock(a=code_block_5, b=code_block_6) { a/b; }
rotated_outside_rectangle = Geometry.Rotate(geometry=outside_rectangle, origin=pointAtParameter, axis=XAxis, degrees=the_modified_angles_for_rotation)
code_block_7 = CodeBlock { 300; }
inside_rectangle = Curve.OffsetMany(curve=rotated_outside_rectangle, signedDistance=code_block_7)
code_block_8 = CodeBlock { "Length"; }
getParameterValueByName_2 = Element.GetParameterValueByName(element=select_model_element, parameterName=code_block_8)
code_block_9 = CodeBlock(a=getParameterValueByName_2, b=the_number_of_points) { (a/b)*0.7; }
extrudeAsSolid = Curve.ExtrudeAsSolid(curve=inside_rectangle, distance=code_block_9)
extrudeAsSolid_2 = Curve.ExtrudeAsSolid(curve=rotated_outside_rectangle, distance=code_block_9)
code_block_10 = CodeBlock(x=pointAtParameter) { x[0]; }
trim = Geometry.Trim(geometry=extrudeAsSolid, other=extrudeAsSolid_2, pick=code_block_10)
the_model_line_on_the_floor_of_2 = Element.Curves(element=select_model_element)  # "The Model Line on the Floor of the Bridge"
code_block_11 = CodeBlock { -1000; }
translate = Geometry.Translate(geometry=the_model_line_on_the_floor_of_2, zTranslation=code_block_11)
startPoint = Curve.StartPoint(curve=translate)
byOriginNormal_2 = Plane.ByOriginNormal(origin=startPoint)
WIDTH = CodeBlock { 800; }
lENGTH = CodeBlock { 8000; }
byWidthLength = Rectangle.ByWidthLength(plane=byOriginNormal_2, width=WIDTH, length=lENGTH)
YAxis = Vector.YAxis()
code_block_12 = CodeBlock { 90; }
rotate = Geometry.Rotate(geometry=byWidthLength, origin=startPoint, axis=YAxis, degrees=code_block_12)
code_block_13 = CodeBlock(l=getParameterValueByName_2) { l; }
extrudeAsSolid_3 = Curve.ExtrudeAsSolid(curve=rotate, distance=code_block_13)
count = List.Count(list=trim)
ofRepeatedItem = List.OfRepeatedItem(item=extrudeAsSolid_3, amount=count)
the_model_line_on_the_floor_of_3 = Element.Curves(element=select_model_element)  # "The Model Line on the Floor of the Bridge"
code_block_14 = CodeBlock { -800; }
translate_2 = Geometry.Translate(geometry=the_model_line_on_the_floor_of_3, zTranslation=code_block_14)
startPoint_2 = Curve.StartPoint(curve=translate_2)
count_2 = List.Count(list=trim)
cycle = List.Cycle(list=startPoint_2, amount=count_2)
trim_2 = Geometry.Trim(geometry=trim, other=ofRepeatedItem, pick=cycle)
byOriginNormal_3 = Plane.ByOriginNormal(origin=startPoint_2)
WIDTH_2 = CodeBlock { 800; }
lENGTH_2 = CodeBlock { 6000; }
byWidthLength_2 = Rectangle.ByWidthLength(plane=byOriginNormal_3, width=WIDTH_2, length=lENGTH_2)
YAxis_2 = Vector.YAxis()
code_block_15 = CodeBlock { 90; }
rotate_2 = Geometry.Rotate(geometry=byWidthLength_2, origin=startPoint_2, axis=YAxis_2, degrees=code_block_15)
extrudeAsSolid_4 = Curve.ExtrudeAsSolid(curve=rotate_2, distance=code_block_13)
ofRepeatedItem_2 = List.OfRepeatedItem(item=extrudeAsSolid_4, amount=count_2)
intersect = Geometry.Intersect(geometry=trim, other=ofRepeatedItem_2)
restOfItems = List.RestOfItems(list=intersect)
code_block_16 = CodeBlock { 28; }
removeItemAtIndex = List.RemoveItemAtIndex(list=restOfItems, indices=code_block_16)
list_create = List.Create(item0=trim_2, item1=removeItemAtIndex)
flatten = List.Flatten(list=list_create)
categories_2 = Categories("OST_GenericModel")
code_block_17 = CodeBlock { "Bridge Mat"; }
byName = Material.ByName(name=code_block_17)
byGeometry = DirectShape.ByGeometry(geometry=flatten, category=categories_2, material=byName)
code_block_18 = CodeBlock(l=getParameterValueByName_2) { l; }
